# Dynamo graph Создание LSP-файла пользовательской библиотеки_РУС.dyn (Dynamo 2.5.2.7915)
# packages: MapConnection 1.0.3

directory_path = Directory("C:\Users\GeorgKeneberg\Documents\Temp")
CS_Language_RUS = MapConnection.MapCSLibrary.CS_Language_RUS()
boolean = BoolSelector(false)
getPartOfMAPCSLIBRARY = MapConnection.MapCSLibrary.GetPartOfMAPCSLIBRARY(Folder_Path=directory_path, CS_value=CS_Language_RUS.CS_value, CS_Agree=CS_Language_RUS.CS_Agree, selection=boolean)
